# Dynamo graph ElementSplitter.dyn (Dynamo 2.6.1.8786)

pick_elements = DSModelElementsSelection()  # 2 picked in the model; graph input
# note: Not available now (not working for cases when top/base constrain in list of hidden levels)
true_split_by_all_levels_false = BoolSelector(true)  # "True = Split by all levels. False = Split by visible levels in current view"; graph input
create_groups_of_splitted = BoolSelector(false)  # "Create groups of splitted elements?"; graph input
python_script = Python(IN[0]=pick_elements, IN[1]=true_split_by_all_levels_false, IN[2]=create_groups_of_splitted)
# ---------- python_script.python (847 lines) ----------
import clr
from sys import path as sysPath
sysPath.append("C:\Program Files (x86)\IronPython 2.7\Lib")
import math

#Import List[Type](iterable)
from System.Collections.Generic import List as sysList

# Import DocumentManager and TransactionManager
clr.AddReference("RevitServices")
import RevitServices
from RevitServices.Persistence import DocumentManager
from RevitServices.Transactions import TransactionManager

# Import RevitAPI
clr.AddReference("RevitAPI")
import Autodesk.Revit.DB as db
doc = DocumentManager.Instance.CurrentDBDocument

# Setting of tolerances
class ConfigSettings:
	
	# ratio of verticalness of an element
	verticalRatio = 0.0001
	#Tolerance of level location
	elevationTolerance = 0.02
	# bottom pipe level offset when element is not splitted when difference is less
	# in feet
	offsetToleranceMEP = 0.5
	
	
# functions collecting side elements
def getListOfLevelIds(doc):
	fltr = db.ElementCategoryFilter(db.BuiltInCategory.OST_Levels)
	if (IN[1]):
		allLevels = db.FilteredElementCollector(doc).WherePasses(fltr).WhereElementIsNotElementType().ToElements()
	else:
		allLevels = db.FilteredElementCollector(doc, doc.ActiveView.Id).WherePasses(fltr).WhereElementIsNotElementType().ToElements()
	lst = list()
	for level in sorted(allLevels, key=lambda x: x.Elevation):
		lst.append(level.Id)
	return lst

# Dedicated class for opening which is hosted in a wall
class WallOpenings():

	def __init__(self, levels, wall, doc):
		self.levels = levels
		self.wall = wall
		self.doc = doc
		self.getListOfOpeningsHostedInWall()
		self.createDictionaryOpeningAndItsLevel()

	# Deletes openings which are not in boundries of new/edited wall element
	def deleteOpeningsNotInWallRange(self):
		wallBaseConstrainId = self.wall.get_Parameter(db.BuiltInParameter.WALL_BASE_CONSTRAINT).AsElementId()
		wallBaseOffset = self.wall.get_Parameter(db.BuiltInParameter.WALL_BASE_OFFSET).AsDouble()
		wallTopConstrain = self.wall.get_Parameter(db.BuiltInParameter.WALL_HEIGHT_TYPE).AsElementId()
		wallTopOffset = self.wall.get_Parameter(db.BuiltInParameter.WALL_TOP_OFFSET).AsDouble()

		wallBaseElevation = self.doc.GetElement(wallBaseConstrainId).Elevation + wallBaseOffset
		wallTopElevation = self.doc.GetElement(wallTopConstrain).Elevation + wallTopOffset
		TransactionManager.Instance.EnsureInTransaction(self.doc)
		for openingId in self.openingDictionary:
			openingElevation = self.openingDictionary[openingId]
			if openingElevation < wallBaseElevation or openingElevation > wallTopElevation:
				self.doc.Delete(openingId)
		TransactionManager.Instance.TransactionTaskDone()
		   
	# Creates list of openings elements ids and assigns it to allOpeningsId element
	def getListOfOpeningsHostedInWall(self):
		self.allOpeningsId = self.wall.GetDependentElements(db.ElementCategoryFilter(db.BuiltInCategory.OST_GenericModel))
		
	# Creates dictionary of openings. Pair is openingId : levelId
	def createDictionaryOpeningAndItsLevel(self):
		self.openingDictionary = {}
		for openingId in self.allOpeningsId:
			opening = doc.GetElement(openingId)
			self.openingDictionary[openingId] = self.getElevationOfOpening(opening)
		return self.openingDictionary

	# Returns levelId of the closest to an opening
	def getElevationOfOpening(self, opening):
		openingLevelId = opening.LookupParameter("Level").AsElementId()
		openingLevel = self.doc.GetElement(openingLevelId)
		index = self.levels.index(openingLevelId)
		try:
			openingGeneralElevation = openingLevel.Elevation + opening.LookupParameter("Elevation").AsDouble()
		except AttributeError:
			openingGeneralElevation = openingLevel.Elevation + opening.LookupParameter("Elevation from Level").AsDouble()
		return openingGeneralElevation

	# Gets level index in list of levels
	def getLevelIndex(self, index, opening, openingGeneralElevation):
		i = index
		while i < len(self.levels):
			levelElement = doc.GetElement(self.levels[i])
			if levelElement.Elevation <= openingGeneralElevation:
				index = i
			else:
				break
			i += 1
		return index


# Abstract class - main class
class ElementSplitter():

	def __init__(self, doc, element):
		self.doc = doc
		self.element = element
		self.levelIdsList = getListOfLevelIds(doc)
		self.listLevels = self.convertListOfLevelIdsToElements()
		self.listOfElements = list()
	
	# Lanuch function which tries to modify offsets
	def modifyLevelsAndOffsets(self):
		self.tryToModifyBaseBoundries()
		self.tryToModifyTopBoundries()
	
	# Gets data from splitting element
	def getElementData(self):
		self.param_Mark = self.element.LookupParameter("Mark").AsString()
	
	# Sets basic parameters to newly created elements
	def setElementData(self, element):
		TransactionManager.Instance.EnsureInTransaction(self.doc)
		try:
			element.LookupParameter("Mark").Set(self.param_Mark)
		except:
			pass
		TransactionManager.Instance.TransactionTaskDone()
	
	# Copies element
	def copyElement(self):
		TransactionManager.Instance.EnsureInTransaction(self.doc)
		element = db.ElementTransformUtils.CopyElement(self.doc, self.element.Id, db.XYZ(0,0,0))
		TransactionManager.Instance.TransactionTaskDone()
		return element

	# Deletes element
	def deleteOriginalElement(self):
		TransactionManager.Instance.EnsureInTransaction(self.doc)
		self.doc.Delete(self.element.Id)
		TransactionManager.Instance.TransactionTaskDone()

	# Additional element for columns with top offset
	def additionalElementWhileTopOffset(self, index):
		if self.getTopOffsetValue() != 0:
			element = self.doc.GetElement(self.copyElement()[0])
			self.setBaseOffsetValue(element, 0)
			self.setTopOffsetValue(element, self.getTopOffsetValue())
			self.setBaseConstraintLevelId(element, self.levelIdsList[index + 1])
			self.setTopConstraintLevelId(element, self.levelIdsList[index + 1])
			self.additionalModificationOfElement(element)
			return element

	def createGroup(self):
		lst = list()
		for el in self.listOfElements:
			lst.append(el.Id)
		newList = sysList[db.ElementId](lst)
		TransactionManager.Instance.EnsureInTransaction(self.doc)
		self.doc.Create.NewGroup(newList)
		TransactionManager.Instance.TransactionTaskDone()

	# General function for splitting elements
	def splitElement(self):
		self.getElementData()
		if self.isElementPossibleToSplit():
			self.listOfElementsToJoin = list()
			startLevelIndex = self.getIndexOfBaseLevel()
			endLevelIndex = self.getIndexOfTopLevel()
			for i in range(startLevelIndex, endLevelIndex):
				elementToChange = self.doc.GetElement(self.copyElement()[0])
				self.listOfElementsToJoin.append(elementToChange)
				if i == startLevelIndex:
					self.setBaseOffsetValue(elementToChange, self.getBaseOffsetValue())
					self.setTopOffsetValue(elementToChange, 0)
				elif i == endLevelIndex - 1:
					self.setBaseOffsetValue(elementToChange, 0)
					# optionaly two lines below might be replaced with:
					# self.setTopOffsetValue(elementToChange, self.getTopOffsetValue())
					self.setTopOffsetValue(elementToChange, 0)
					additionalElement = self.additionalElementWhileTopOffset(i)
					self.listOfElementsToJoin.append(additionalElement)
				else:
					self.setBaseOffsetValue(elementToChange, 0)
					self.setTopOffsetValue(elementToChange, 0)
					self.setElementData(elementToChange)
				self.setBaseConstraintLevelId(elementToChange, self.levelIdsList[i])
				self.setTopConstraintLevelId(elementToChange, self.levelIdsList[i+1])
				self.additionalModificationOfElement(elementToChange)
				self.listOfElements.append(elementToChange)
			self.joinElementsInList()
			self.deleteOriginalElement()
			if IN[2]:
				self.createGroup()
	
	# Joins list of elements 
	def joinElementsInList(self):
		TransactionManager.Instance.EnsureInTransaction(self.doc)
		for i in range(len(self.listOfElementsToJoin)-1):
			try:
				db.JoinGeometryUtils.JoinGeometry(self.doc, self.listOfElementsToJoin[i], self.listOfElementsToJoin[i + 1])
			except:
				pass
		TransactionManager.Instance.TransactionTaskDone()

	# Adds Additional modification to element or its subelements
	def additionalModificationOfElement(self, elementToChange):
		pass

	# checks if element goes trought more than
	def isElementPossibleToSplit(self):
		try:
			self.modifyLevelsAndOffsets()
			startLevelIndex = self.getIndexOfBaseLevel()
			endLevelIndex = self.getIndexOfTopLevel()
			if startLevelIndex + 1 == endLevelIndex:
				return False
			else:
				return True
		except:
			return False
		
	# Calculates distance between levels
	def getDistanceBetweenLevels(self, originalLevelIndex, newLevelIndex):
		listOfLevels = self.convertListOfLevelIdsToElements()
		return listOfLevels[originalLevelIndex].Elevation - listOfLevels[newLevelIndex].Elevation

	# Converts list of levels ids to elements
	def convertListOfLevelIdsToElements(self):
		lst = list()
		for levelId in self.levelIdsList:
			lst.append(self.doc.GetElement(levelId))
		return lst

	# tries to modify element to set level as high as it is possible
	# and reduce offset. Instead of situation: Level no 3 with offset 10m
	# it changes elements base level ie. Level no 5 with offset -50cm 
	def tryToModifyTopBoundries(self):
		lst = list()
		levels = self.convertListOfLevelIdsToElements()
		try:
			index = self.getIndexOfTopLevel()
			endLevelOffset = self.getTopOffsetValue()
		# means it's unconnected wall so treat base constraint as top with 
		# offset as unconnected height +/- base offset value
		except ValueError:
			index = self.getIndexOfBaseLevel()
			if self.getBaseOffsetValue() < 0:
				endLevelOffset = self.getHeight() + self.getBaseOffsetValue()
			else:
				endLevelOffset = self.getHeight() - self.getBaseOffsetValue()
		elementElevation = levels[index].Elevation + endLevelOffset
		indexOfNewLevel = None
		for i in range(len(levels)):
			if levels[i].Elevation <= elementElevation:
				indexOfNewLevel = i
				lst.append(indexOfNewLevel)
			else:
				break
		if indexOfNewLevel != None:
			return self.setNewTopBoundries(index, indexOfNewLevel)

	# Sets new top boundry for element
	def setNewTopBoundries(self, levelIndex, newLevelIndex):
		differenceInOffset = self.getDistanceBetweenLevels(levelIndex, newLevelIndex)
		# if wall is unconnected
		if self.getTopConstraintLevelId().IntegerValue == -1:
			newOffset = self.getHeight() + self.getBaseOffsetValue() + differenceInOffset
		# Top is constrained to level
		else:
			newOffset = self.getTopOffsetValue() + differenceInOffset
		newLevelId = self.levelIdsList[newLevelIndex]
		TransactionManager.Instance.EnsureInTransaction(doc)
		self.setTopConstraintLevelId(self.element, newLevelId)
		self.setTopOffsetValue(self.element, newOffset)
		TransactionManager.Instance.TransactionTaskDone()

	# tries to modify element to set level as low as it is possible
	# and reduce offset. Instead of situation: Level no 3 with offset -10m
	# it changes elements base level ie. Level no 0 with offset -50cm 
	def tryToModifyBaseBoundries(self):
		index = self.getIndexOfBaseLevel()
		startLevelId = self.getBaseConstraintLevelId()
		startLevelOffset = self.getBaseOffsetValue()
		levels = self.convertListOfLevelIdsToElements()
		if index != 0:
			indexOfNewLevel = None
			for i in range(index, 0, -1):
				lvlIndex = i - 1
				if startLevelOffset <= (levels[lvlIndex].Elevation - levels[index].Elevation):
					indexOfNewLevel = lvlIndex
				else:
					break
			if indexOfNewLevel != None:
				self.setNewBaseBoundries(index, indexOfNewLevel)

	# Sets new base boundry for element
	def setNewBaseBoundries(self, levelIndex, newLevelIndex):
		differenceInOffset = self.getDistanceBetweenLevels(levelIndex, newLevelIndex)
		newOffset = self.getBaseOffsetValue() + differenceInOffset
		newLevelId = self.levelIdsList[newLevelIndex]
		TransactionManager.Instance.EnsureInTransaction(doc)
		self.setBaseConstraintLevelId(self.element, newLevelId)
		self.setBaseOffsetValue(self.element, newOffset)
		TransactionManager.Instance.TransactionTaskDone()
	
	# Returns index of top level on the list of levels
	def getIndexOfTopLevel(self):
		endLevelId = self.getTopConstraintLevelId()
		return self.levelIdsList.index(endLevelId)

	# Returns index of base level on the list of levels
	def getIndexOfBaseLevel(self):
		startLevelId = self.getBaseConstraintLevelId()
		return self.levelIdsList.index(startLevelId)


# Class for walls
class WallSplitter(ElementSplitter):

#GETTERS

	# Returns base constraint levelId
	def getBaseConstraintLevelId(self):
		return self.element.get_Parameter(db.BuiltInParameter.WALL_BASE_CONSTRAINT).AsElementId()

	# Returns base offset value
	def getBaseOffsetValue(self):
		return self.element.get_Parameter(db.BuiltInParameter.WALL_BASE_OFFSET).AsDouble()

	# Returns unconnected height
	def getHeight(self):
		return self.element.get_Parameter(db.BuiltInParameter.WALL_USER_HEIGHT_PARAM).AsDouble()

	# Returns top constraint levelId
	def getTopConstraintLevelId(self):
		return self.element.get_Parameter(db.BuiltInParameter.WALL_HEIGHT_TYPE).AsElementId()

	# Returns top offset value
	def getTopOffsetValue(self):
		return self.element.get_Parameter(db.BuiltInParameter.WALL_TOP_OFFSET).AsDouble()

# SETTERS

	# Void, sets base constraint level based on level Id
	def setBaseConstraintLevelId(self, element, levelId):
		element.get_Parameter(db.BuiltInParameter.WALL_BASE_CONSTRAINT).Set(levelId)

	# Void,sets base offset based on value
	def setBaseOffsetValue(self, element, value):
		element.get_Parameter(db.BuiltInParameter.WALL_BASE_OFFSET).Set(value)

	# Void, sets top constraint level based on level Id
	def setTopConstraintLevelId(self, element, levelId):
		element.get_Parameter(db.BuiltInParameter.WALL_HEIGHT_TYPE).Set(levelId)

	# Void,sets top offset based on value
	def setTopOffsetValue(self, element, value):
		element.get_Parameter(db.BuiltInParameter.WALL_TOP_OFFSET).Set(value)

	# Due to openings neccessary to develop additional function
	def additionalModificationOfElement(self, elementToChange):
		objectOfOpenings = WallOpenings(self.levelIdsList, elementToChange, self.doc)
		objectOfOpenings.deleteOpeningsNotInWallRange()


# Class for structural columns and columns
class ColumnSplitter(ElementSplitter):

#GETTERS

	# Returns base constraint
	def getBaseConstraintLevelId(self):
		return self.element.get_Parameter(db.BuiltInParameter.FAMILY_BASE_LEVEL_PARAM).AsElementId()

	def getBaseOffsetValue(self):
		return self.element.get_Parameter(db.BuiltInParameter.FAMILY_BASE_LEVEL_OFFSET_PARAM).AsDouble()

	# Returns unconnected height
	def getHeight(self):
		return self.element.LookupParameter("Length").AsDouble()

	# Returns top constraint levelId
	def getTopConstraintLevelId(self):
		return self.element.get_Parameter(db.BuiltInParameter.FAMILY_TOP_LEVEL_PARAM).AsElementId()

	# Returns top offset value
	def getTopOffsetValue(self):
		return self.element.get_Parameter(db.BuiltInParameter.FAMILY_TOP_LEVEL_OFFSET_PARAM).AsDouble()

# SETTERS

	# Void, sets base constraint level based on level Id
	def setBaseConstraintLevelId(self, element, levelId):
		element.get_Parameter(db.BuiltInParameter.FAMILY_BASE_LEVEL_PARAM).Set(levelId)

	# Void,sets base offset based on value
	def setBaseOffsetValue(self, element, value):
		element.get_Parameter(db.BuiltInParameter.FAMILY_BASE_LEVEL_OFFSET_PARAM).Set(value)

	# Void, sets top constraint level based on level Id
	def setTopConstraintLevelId(self, element, levelId):
		element.get_Parameter(db.BuiltInParameter.FAMILY_TOP_LEVEL_PARAM).Set(levelId)

	# Void,sets top offset based on value
	def setTopOffsetValue(self, element, value):
		element.get_Parameter(db.BuiltInParameter.FAMILY_TOP_LEVEL_OFFSET_PARAM).Set(value)


# Class for slanted columns
class SlantedColumnSplitter(ColumnSplitter):

#GETTERS  - inherits from parent
	
	# Gets data from splitting element
	def getElementData(self):
		self.param_Mark = self.element.LookupParameter("Mark").AsString()
		self.param_BaseCutStyle = self.element.get_Parameter(db.BuiltInParameter.SLANTED_COLUMN_BASE_CUT_STYLE).AsInteger()
		self.param_TopCutStyle = self.element.get_Parameter(db.BuiltInParameter.SLANTED_COLUMN_TOP_CUT_STYLE).AsInteger()

# SETTERS - inherits from parent
	
	# Sets basic parameters to newly created elements
	def setElementData(self, element):
		TransactionManager.Instance.EnsureInTransaction(self.doc)
		try:
			element.LookupParameter("Mark").Set(self.param_Mark)
		# pass while mark == None
		except TypeError:
			pass
		element.get_Parameter(db.BuiltInParameter.SLANTED_COLUMN_BASE_CUT_STYLE).Set(self.param_BaseCutStyle)
		element.get_Parameter(db.BuiltInParameter.SLANTED_COLUMN_TOP_CUT_STYLE).Set(self.param_TopCutStyle)
		TransactionManager.Instance.TransactionTaskDone()

	# Gets difference between start and end point Z Coordinate
	def getElementVerticalHeight(self, element):
		if type(element) == db.ElementId:
			element = self.doc.GetElement(element)
		elementCurve = element.Location.Curve
		return elementCurve.GetEndPoint(1).Z - elementCurve.GetEndPoint(0).Z

	# Splits proper levels for elements which has offset different than 0
	def setOffsetForLastElement(self, element, index, coefficient):
		if round(coefficient, 3) > 0 and round(coefficient, 3) < 1:
			self.setBaseConstraintLevelId(element, self.levelIdsList[index + 1])
			self.setTopConstraintLevelId(element, self.levelIdsList[index + 1])
		else:
			self.setBaseConstraintLevelId(element, self.levelIdsList[index])
			self.setTopConstraintLevelId(element, self.levelIdsList[index + 1])
	
	# splits slantedColumnIntoTwoElements
	def splitColumnIntoTwoElements(self, element, index, coefficinet):
		oldElement = element
		if round(coefficinet, 3) > 0 and round(coefficinet, 3) < 1:
				TransactionManager.Instance.EnsureInTransaction(self.doc)
				elementBeingSplit = self.doc.GetElement(element.Split(coefficinet))
				TransactionManager.Instance.TransactionTaskDone()
				self.setBaseConstraintLevelId(oldElement, self.levelIdsList[index])
				self.setTopConstraintLevelId(oldElement, self.levelIdsList[index + 1])
				self.setElementData(oldElement)
				return elementBeingSplit
		else:
			return element

	# Splits slanted column
	def splitElement(self):
		self.getElementData()
		if self.isElementPossibleToSplit():
			startLevelIndex = self.getIndexOfBaseLevel()
			endLevelIndex = self.getIndexOfTopLevel()
			elementBeingSplit = self.element
			self.listOfElements.append(self.element)
			for i in range(startLevelIndex, endLevelIndex):
				splitedElementLength = self.getElementVerticalHeight(elementBeingSplit)
				if i == startLevelIndex:
					segmentLen = self.doc.GetElement(self.levelIdsList[i+1]).Elevation - self.doc.GetElement(self.levelIdsList[i]).Elevation - self.getBaseOffsetValue()
				elif i == endLevelIndex - 1:
					segmentLen = self.doc.GetElement(self.levelIdsList[i+1]).Elevation - self.doc.GetElement(self.levelIdsList[i]).Elevation + self.getTopOffsetValue()
				else:
					segmentLen = self.doc.GetElement(self.levelIdsList[i+1]).Elevation - self.doc.GetElement(self.levelIdsList[i]).Elevation
				coefficientOfSplitting = segmentLen/splitedElementLength
				elementBeingSplit = self.splitColumnIntoTwoElements(elementBeingSplit, i, coefficientOfSplitting)
				self.listOfElements.append(elementBeingSplit)
			try:
				self.setOffsetForLastElement(elementBeingSplit, i, coefficientOfSplitting)
				self.setElementData(elementBeingSplit)
			except:
				pass
			if IN[2]:
				self.createGroup()


# Abstract class for MEP elements which is inherited by certain MEP categories
class MepElement(ElementSplitter):
	
	# Splits elements by levels (if applicable)
	def splitElement(self):
		self.getConnectedElements()
		if not self.isElementPossibleToSplit():
			self.setBaseLevelToElement(self.element)
		elementToSplit = self.element
		self.listOfElements.append(self.element)
		for level in self.listLevels:
			levelElevation = level.ProjectElevation
			if elementToSplit == None:
				break
			elif levelElevation > self.startPoint.Z + ConfigSettings.offsetToleranceMEP and levelElevation + ConfigSettings.elevationTolerance < self.endPoint.Z:
				elementToSplit = self.splitVerticalElement(elementToSplit, level)
		# Additional method dedicated for conection of electrical elements due to lack of breakCurve method for electrical elements
		if self.element.GetType() == db.Electrical.CableTray or self.element.GetType() == db.Electrical.Conduit:
    			self.connectElements()
		if IN[2]:
			self.createGroup()


	
	# Implementation in ElectricalElementsSplitter 
	def connectElements(self):
		pass
	
	# Implementation in ElectricalElementsSplitter 
	def disconnectElement():
		pass

	def getConnectedElements(self):
		self.connectorsToJoin = list()
		# CableTrays always have 2 connectors
		connectorManager = self.element.ConnectorManager
		for i in range(2):
			for j in connectorManager.Lookup(i).AllRefs:
				if j.Owner.Id != self.element.Id:
					self.connectorsToJoin.append(j)
		self.disconnectElement()

	# Assign levelId to each of MEP element in the list. levelId is assinged to level parameter of an element
	def assignLevelsToElements(self, elements):
		for element in elements:
			self.setBaseLevelToElement(element)

	# Assign levelId to an element. LevelId is assinged to level parameter of an element
	def setBaseLevelToElement(self, element):
		elementCurve = element.Location.Curve
		if self.elementLocationStyle == "TopToDown":
			elementStartPoint = elementCurve.GetEndPoint(0)
		else:
			elementStartPoint = elementCurve.GetEndPoint(1)
		for level in self.listLevels:
			elevation = level.ProjectElevation
			if self.listLevels.index(level) == 0 and elementStartPoint < elevation:
				self.setBaseConstraintLevelId(element, self.levelIdsList[0])

	# Splits element but calculated point. Point Z coordinate is calculate base on level
	def splitVerticalElement(self, elementToSplit, cutLevel):
		tempElementCurve = elementToSplit.Location.Curve
		endPoint = tempElementCurve.GetEndPoint(1)
		startPoint = tempElementCurve.GetEndPoint(0)
		vectorFromStartPointToEndPoint = endPoint - startPoint
		proportionOfDistanceToCutLocation = math.fabs(startPoint.Z - cutLevel.ProjectElevation)/startPoint.DistanceTo(endPoint)
		cutPoint = startPoint + vectorFromStartPointToEndPoint * proportionOfDistanceToCutLocation
		return self.cutElementAndAssignUnionsPlusLevels(elementToSplit, cutPoint)

	# checkes if element is almost vertical, it check is horizontal distance ratio between top and down in order 
	# to vertical distance is less than 0.0001
	def checkIfElementIsAlmostVertical(self):
		verticalLength = math.fabs(self.endPoint.Z - self.startPoint.Z)
		horizontalLength = math.sqrt(math.fabs(self.endPoint.X - self.startPoint.X)**2 + math.fabs(self.endPoint.Y - self.startPoint.Y)**2)
		try:
			if horizontalLength/verticalLength <= ConfigSettings.verticalRatio:
				return True
			else:
				return False
		#In case if two elements are at the same elevation
		except ZeroDivisionError:
			return False

	# checks style of a MEP element is it model from Top to Down or from Down to Top and assignes parameter
	def setElementModelingStyle(self):
		location = self.element.Location.Curve
		originalStart = location.GetEndPoint(0)
		originalEnd = location.GetEndPoint(1)
		if originalStart.Z > originalEnd.Z:
			self.elementLocationStyle = "TopToDown"
			self.startPoint = originalEnd
			self.endPoint = originalStart
		else:
			self.elementLocationStyle = "DownToTop"
			self.startPoint = originalStart
			self.endPoint = originalEnd

	# checks if element goes trought more than
	def isElementPossibleToSplit(self):
		self.setElementModelingStyle()
		if not self.checkIfElementIsAlmostVertical():
			return False
		startPointLevelIndex = None
		endPointLevelIndex = None
		for level in self.listLevels:
			levelElevation = level.ProjectElevation
			if self.startPoint.Z < levelElevation and self.endPoint.Z > levelElevation + ConfigSettings.elevationTolerance:
				return True
			else:
				continue
		if self.startPoint.Z < levelElevation and self.endPoint.Z > levelElevation + ConfigSettings.elevationTolerance:
				return True
		return False

	# tries to modify element to set level as low as it is possible
	# and reduce offset. Instead of situation: Level no 3 with offset -10m
	# it changes elements base level ie. Level no 0 with offset -50cm 
	
	#GETTERS
	# Returns base constraint levelId
	def getBaseConstraintLevelId(self):
		return self.element.get_Parameter(db.BuiltInParameter.RBS_START_LEVEL_PARAM).AsElementId()

	# Returns base offset value
	def getBaseOffsetValue(self):
		return self.element.get_Parameter(db.BuiltInParameter.RBS_START_OFFSET_PARAM).AsDouble()

	#SETTERS
	# Void, sets base constraint level based on level Id
	def setBaseConstraintLevelId(self, element, levelId):
		TransactionManager.Instance.EnsureInTransaction(self.doc)
		element.get_Parameter(db.BuiltInParameter.RBS_START_LEVEL_PARAM).Set(levelId)
		TransactionManager.Instance.TransactionTaskDone()
		return 

	# Sets new base boundry for element
	def setNewBaseBoundries(self, levelIndex, newLevelIndex):
		differenceInOffset = self.getDistanceBetweenLevels(levelIndex, newLevelIndex)
		newLevelId = self.levelIdsList[newLevelIndex]
		TransactionManager.Instance.EnsureInTransaction(doc)
		self.setBaseConstraintLevelId(self.element, newLevelId)
		TransactionManager.Instance.TransactionTaskDone()

	# AddsConnector based on elementLocationStyle modeling style 
	def createNewUnion(self, newConnector, oldConnector):
		TransactionManager.Instance.EnsureInTransaction(self.doc)
		if self.elementLocationStyle == "TopToDown":
			union = self.doc.Create.NewUnionFitting(oldConnector, newConnector)
		else:
			union = self.doc.Create.NewUnionFitting(newConnector, oldConnector)
		TransactionManager.Instance.TransactionTaskDone()
		return union

	# Adds MEP element union 
	def addUnion(self, newElement, elementToSplit):
		newElementManager = newElement.ConnectorManager
		oldElementManager = elementToSplit.ConnectorManager
		for i in range(2):
			for j in range(2):
				newConnector = newElementManager.Lookup(i)
				oldConnector = oldElementManager.Lookup(j)
				if newConnector.Origin.IsAlmostEqualTo(oldConnector.Origin):
					return self.createNewUnion(newConnector, oldConnector)

	def getStartEndZCoordinateTuple(self, element):
		elementCurve = element.Location.Curve
		point_1 = elementCurve.GetEndPoint(0).Z
		point_2 = elementCurve.GetEndPoint(1).Z
		if point_1 < point_2:
			return (point_1, point_2)
		else:
			return (point_2, point_1)

	# Assigns element to proper level
	def assignProperLevelToElement(self, element):
		coordinates = self.getStartEndZCoordinateTuple(element)
		startPoint = coordinates[0]
		endPoint = coordinates[1]
		for level in self.listLevels:
			elevation = level.ProjectElevation
			levelIndex = self.listLevels.index(level)
			if elevation + ConfigSettings.elevationTolerance > startPoint and elevation - ConfigSettings.elevationTolerance < startPoint:
				break
			elif elevation + ConfigSettings.elevationTolerance > endPoint and elevation - ConfigSettings.elevationTolerance < endPoint:
				if levelIndex != 0 and not (startPoint > elevation and endPoint >= elevation):
					levelIndex = levelIndex - 1
				break
		self.setBaseConstraintLevelId(element, self.levelIdsList[levelIndex])

	# function assings level to elements and adds union
	# it's possible to opimize: not set parameters to splitting element after
	# each iteration, but than unions will not be assigned to proper level 
	def assignElementsToLevelsAndAddUnion(self, newElement, elementToSplit):
		if elementToSplit != None:
			self.assignProperLevelToElement(elementToSplit)
		if newElement != None:
			self.assignProperLevelToElement(newElement)
		if newElement != None:
			self.listOfElements.append(self.addUnion(newElement, elementToSplit))


# Class for duct elements
class DuctSplitter(MepElement):

	# Function splitting a duct into 2 elements
	def cutElementAndAssignUnionsPlusLevels(self, elementToSplit, cutPoint):
		TransactionManager.Instance.EnsureInTransaction(self.doc)
		try:
			newElementId = db.Mechanical.MechanicalUtils.BreakCurve(self.doc, elementToSplit.Id, cutPoint)
			newElement = self.doc.GetElement(newElementId)
		except:
			newElement = None
		self.listOfElements.append(newElement)
		TransactionManager.Instance.TransactionTaskDone()
		self.assignElementsToLevelsAndAddUnion(newElement, elementToSplit)
		if self.elementLocationStyle == "TopToDown":
			return newElement
		return elementToSplit


# Class for pipes (plumbing elements - not Conduits)
class PipeSplitter(MepElement):

	# Function splitting a duct into 2 elements
	def cutElementAndAssignUnionsPlusLevels(self, elementToSplit, cutPoint):
		TransactionManager.Instance.EnsureInTransaction(self.doc)
		try:
			newElementId = db.Plumbing.PlumbingUtils.BreakCurve(self.doc, elementToSplit.Id, cutPoint)
			newElement = self.doc.GetElement(newElementId)
		except:
			newElement = None
		self.listOfElements.append(newElement)
		TransactionManager.Instance.TransactionTaskDone()
		self.assignElementsToLevelsAndAddUnion(newElement, elementToSplit)
		if self.elementLocationStyle == "TopToDown":
			return newElement
		return elementToSplit


class ElectricalElementsSplitter(MepElement):
	
	# Copy element and get new one
	def getElementCopy(self):
		new = db.ElementTransformUtils.CopyElement(self.doc, self.element.Id, db.XYZ(0, 0, 0))
		newElementId = list(new)[0]
		newElement = self.doc.GetElement(newElementId)
		self.listOfElements.append(newElement)
		return newElement

	# Function splitting a duct into 2 elements
	def cutElementAndAssignUnionsPlusLevels(self, elementToSplit, cutPoint):
		TransactionManager.Instance.EnsureInTransaction(self.doc)
		if self.elementLocationStyle == "TopToDown":
			elementToSplitLine = db.Line.CreateBound(self.element.Location.Curve.GetEndPoint(0), cutPoint)
			newElementLine = db.Line.CreateBound(self.element.Location.Curve.GetEndPoint(1), cutPoint)
		else:
			elementToSplitLine = db.Line.CreateBound(cutPoint, self.element.Location.Curve.GetEndPoint(1))
			newElementLine = db.Line.CreateBound(self.element.Location.Curve.GetEndPoint(0), cutPoint)
		newElement = self.getElementCopy()
		elementToSplit.Location.Curve = elementToSplitLine
		newElement.Location.Curve = newElementLine
		self.assignElementsToLevels(elementToSplit, newElement)
		TransactionManager.Instance.TransactionTaskDone()
		return elementToSplit

	# There is no way to predict location of union in cableTrays, that is why 
	# decided to implement additional functionality - connectElements, which does it
	def assignElementsToLevels(self, newElement, elementToSplit):
		if elementToSplit != None:
			self.assignProperLevelToElement(elementToSplit)
		if newElement != None:
			self.assignProperLevelToElement(newElement)

	def getConnectorsFromElement(self, element):
		connectorsList = list(element.ConnectorManager.Connectors)
		for connector in connectorsList:
			self.connectorsToJoin.append(connector)

	def addAllConnectorsToTheList(self):
		for element in self.listOfElements:
			self.getConnectorsFromElement(element)

	# Connects all elements together to create system connector
	def connectElements(self):
		oldConnectors = self.connectorsToJoin
		self.addAllConnectorsToTheList()
		sortedByLevel = sorted(self.connectorsToJoin, key = lambda x : x.Origin.Z)
		for connectorIndex in range(len(sortedByLevel) - 1):
			mainConnector = sortedByLevel[connectorIndex]
			# Get next item in list
			connectorToCheck = sortedByLevel[connectorIndex + 1]
			if mainConnector.Origin.IsAlmostEqualTo(connectorToCheck.Origin):
				try:
					self.listOfElements.append(self.createNewUnion(mainConnector, connectorToCheck))
				except:
					TransactionManager.Instance.EnsureInTransaction(self.doc)
					mainConnector.ConnectTo(connectorToCheck)
					TransactionManager.Instance.TransactionTaskDone


	# Disconnects electrical elements from fitting for splitting process
	def disconnectElement(self):
		connectorManager = self.element.ConnectorManager
		for connectorIndex in range(2):
			connectorOfOriginalElement = connectorManager.Lookup(connectorIndex)
			for connectorToDisconnect in self.connectorsToJoin:
				if connectorOfOriginalElement.IsConnectedTo(connectorToDisconnect):
					TransactionManager.Instance.EnsureInTransaction(self.doc)
					connectorOfOriginalElement.DisconnectFrom(connectorToDisconnect)
					TransactionManager.Instance.TransactionTaskDone()

def getlistOfElements():
	try:
		numberOfElements = len(IN[0])
		if numberOfElements > 1:
			return IN[0]
		else:
			return [IN[0]]
	except:
		return [IN[0]]

for elementToSplit in getlistOfElements():
	# converts dynamo element (elementToSplit) to revit element
	try:
		revitElement = doc.GetElement(db.ElementId(elementToSplit.Id))
	except AttributeError:
		continue		
	# Tries to get revit element type
	try:
		elementType = revitElement.GetType()
	except TypeError:
		elementType = None
	element = None
	if elementType == db.Wall:
		element = WallSplitter(doc, revitElement)
	elif elementType == db.FamilyInstance:
		structuralType = revitElement.StructuralType
		if structuralType == db.Structure.StructuralType.Column and not revitElement.IsSlantedColumn:
			element = ColumnSplitter(doc, revitElement)
		elif structuralType == db.Structure.StructuralType.Column and revitElement.IsSlantedColumn:
			element = SlantedColumnSplitter(doc, revitElement)
	elif elementType == db.Mechanical.Duct:
		element = DuctSplitter(doc, revitElement)
	elif elementType == db.Plumbing.Pipe:
		element = PipeSplitter(doc, revitElement)
	elif elementType == db.Electrical.CableTray or elementType == db.Electrical.Conduit:
		element = ElectricalElementsSplitter(doc, revitElement)
	if element != None:
		element.splitElement()

OUT = "done", dir(element.connectorsToJoin[0].Origin)
# ----------------------------------------
